# Dynamo graph Upgrade_Families_To_2022.dyn (Dynamo 2.12.1.8246)

# group: UPGRADE FAMILIES TO REVIT 2022
# note: DYNAMO VERSION: 2.12.1.8411
# VERSION: 1.0
# CREATED BY: Emelie Wärmlund
# DATE CREATED: 2024-10-16
# LAST MODIFIED:
# DESCRIPTION:
# This script upgrades all revit families in a directory that has a version from before Revit 2022

# group: USER INPUT
select_folder = Directory("")  # graph input

# group: PYTHON
retrieve_old_families = Python(IN[0]=select_folder)  # CPython3
# ---------- retrieve_old_families.python (47 lines) ----------
import os
import re

# Directory containing the Revit families (.rfa files)
directory_path = IN[0]

old_family_paths=[]
versions=[]
failed=[]
# Function to extract and check Revit version from a Revit family file
def get_revit_version_from_rfa(file_path):
    try:
        # Read the .rfa file as binary
        with open(file_path, 'rb') as file:
            content = file.read()

            # Decode to a string for XML parsing (ignoring errors)
            content_str = content.decode('utf-8', errors='ignore')

            # Use regex to search for the <A:product-version> tag
            match = re.search(r'<A:product-version>(.*?)</A:product-version>', content_str)
            if match:
                return match.group(1)  # Return the version number found
            else:
                return null
    except Exception as e:
        return failed.append("Error reading {}: {}".format(file_path, str(e)))

# Function to loop through a directory and check all .rfa files
def check_directory_for_revit_versions(directory_path):
    for root_dir, dirs, files in os.walk(directory_path):
        for file_name in files:
            if file_name.endswith('.rfa'):
                file_path = os.path.join(root_dir, file_name)
                version = get_revit_version_from_rfa(file_path)
                if(version):
                    if(int(version)<2022):
                        old_family_paths.append(file_path)
                    else:
                        continue
                else:
                    continue
                
# Run the check
check_directory_for_revit_versions(directory_path)

OUT= old_family_paths
# ----------------------------------------
update = Python(IN[0]=retrieve_old_families)  # CPython3
# ---------- update.python (42 lines) ----------
import clr
clr.AddReference('RevitAPI')
clr.AddReference('RevitServices')
from Autodesk.Revit.DB import *
from RevitServices.Persistence import DocumentManager
from RevitServices.Transactions import TransactionManager
import System

# Get Revit application instance
app = DocumentManager.Instance.CurrentUIApplication.Application
uiapp = DocumentManager.Instance.CurrentUIApplication

# List of family file paths passed from Dynamo
family_paths = IN[0]  # Input from Dynamo (a list of file paths)

# Lists to track successes and failures
success = []
failed = []

# Loop through each family file path
for path in family_paths:
    try:
        # Open the family document
        family_doc = app.OpenDocumentFile(path)

        # Save the family (upgrading it to the current Revit version)
        save_options = SaveAsOptions()
        save_options.OverwriteExistingFile = True
        family_doc.SaveAs(path, save_options)

        # Close the family document
        family_doc.Close(False)

        # Add to success list
        success.append("Successfully updated: {}".format(path))

    except Exception as e:
        # If there's an error, append to the failed list
        failed.append("Failed to update: {}, Error: {}".format(path, str(e)))

# Output the results
OUT = success, failed
# ----------------------------------------

# group: OUTPUT
results = Watch(update)  # graph output
